# Grasshopper definition ghTest.ghx (Grasshopper 0.8.66)

factor = Panel("0.5")
length = Slider(70, range=0..120)
factor_2 = Panel("2")
width = Slider(46, range=0..120)
leg_skew = Slider(10, range=2..10)
groin_depth = Slider(6, range=3..6)
origin = Panel("0")
table_thickness = Panel(".75")
inset = Panel("3")
addition = Addition(A=table_thickness, B=inset)
addition_2 = Addition(A=origin, B=inset)
subtraction = Subtraction(A=width, B=inset)
subtraction_2 = Subtraction(A=subtraction, B=table_thickness)
height = Slider(48, range=12..48)
subtraction_3 = Subtraction(A=height, B=groin_depth)
subtraction_4 = Subtraction(A=height, B=groin_depth)
leg_width = Slider(7.453, range=2..10)
addition_3 = Addition(A=leg_width, B=inset)
axb = Multiplication(A=leg_width, B=factor_2)
addition_4 = Addition(A=axb, B=leg_width)
addition_5 = Addition(A=leg_width, B=inset)
axb_2 = Multiplication(A=leg_width, B=factor_2)
addition_6 = Addition(A=axb_2, B=leg_width)
subtraction_5 = Subtraction(A=addition_2, B=leg_skew)
subtraction_6 = Subtraction(A=addition, B=leg_skew)
addition_7 = Addition(A=table_thickness, B=height)
subtraction_7 = Subtraction(A=height, B=factor)
axb_3 = Multiplication(A=addition_4, B=factor_2)
addition_8 = Addition(A=origin, B=inset)
subtraction_8 = Subtraction(A=addition_8, B=leg_skew)
subtraction_9 = Subtraction(A=subtraction_2, B=leg_skew)
subtraction_10 = Subtraction(A=addition_5, B=leg_skew)
addition_9 = Addition(A=table_thickness, B=height)
subtraction_11 = Subtraction(A=height, B=factor)
axb_4 = Multiplication(A=addition_6, B=factor_2)
subtraction_12 = Subtraction(A=addition_3, B=leg_skew)
_1 = PointXYZ(XComponent=origin, YComponent=origin, ZComponent=height, System=PlaneXY(0, 0, 0))
_2 = PointXYZ(XComponent=origin, YComponent=width, ZComponent=height, System=PlaneXY(0, 0, 0))
_4 = PointXYZ(XComponent=length, YComponent=width, ZComponent=height, System=PlaneXY(0, 0, 0))
_1_2 = PointXYZ(XComponent=subtraction_5, YComponent=addition_2, ZComponent=origin, System=PlaneXY(0, 0, 0))
_3 = PointXYZ(XComponent=length, YComponent=origin, ZComponent=height, System=PlaneXY(0, 0, 0))
_1_3 = PointXYZ(XComponent=subtraction_12, YComponent=addition_2, ZComponent=origin, System=PlaneXY(0, 0, 0))
_1_4 = PointXYZ(XComponent=subtraction_8, YComponent=subtraction, ZComponent=origin, System=PlaneXY(0, 0, 0))
_1_5 = PointXYZ(XComponent=subtraction_10, YComponent=subtraction, ZComponent=origin, System=PlaneXY(0, 0, 0))
_1_6 = PointXYZ(XComponent=subtraction_12, YComponent=addition, ZComponent=origin, System=PlaneXY(0, 0, 0))
_1_7 = PointXYZ(XComponent=subtraction_5, YComponent=addition, ZComponent=origin, System=PlaneXY(0, 0, 0))
_1_8 = PointXYZ(XComponent=subtraction_10, YComponent=subtraction_2, ZComponent=origin, System=PlaneXY(0, 0, 0))
_1_9 = PointXYZ(XComponent=subtraction_8, YComponent=subtraction_2, ZComponent=origin, System=PlaneXY(0, 0, 0))
_1_10 = PointXYZ(XComponent=addition_2, YComponent=addition, ZComponent=height, System=PlaneXY(0, 0, 0))
_1_11 = PointXYZ(XComponent=addition_4, YComponent=addition_2, ZComponent=subtraction_7, System=PlaneXY(0, 0, 0))
_1_12 = PointXYZ(XComponent=addition_2, YComponent=addition_2, ZComponent=height, System=PlaneXY(0, 0, 0))
_1_13 = PointXYZ(XComponent=addition_3, YComponent=addition_2, ZComponent=subtraction_3, System=PlaneXY(0, 0, 0))
_1_14 = PointXYZ(XComponent=addition_3, YComponent=addition, ZComponent=subtraction_3, System=PlaneXY(0, 0, 0))
_1a = PointXYZ(XComponent=origin, YComponent=origin, ZComponent=addition_7, System=PlaneXY(0, 0, 0))
_2a = PointXYZ(XComponent=origin, YComponent=width, ZComponent=addition_7, System=PlaneXY(0, 0, 0))
_4a = PointXYZ(XComponent=length, YComponent=width, ZComponent=addition_7, System=PlaneXY(0, 0, 0))
_3a = PointXYZ(XComponent=length, YComponent=origin, ZComponent=addition_7, System=PlaneXY(0, 0, 0))
_1_15 = PointXYZ(XComponent=addition_5, YComponent=subtraction, ZComponent=subtraction_4, System=PlaneXY(0, 0, 0))
_1_16 = PointXYZ(XComponent=addition_8, YComponent=subtraction_2, ZComponent=height, System=PlaneXY(0, 0, 0))
_1_17 = PointXYZ(XComponent=addition_5, YComponent=subtraction_2, ZComponent=subtraction_4, System=PlaneXY(0, 0, 0))
_1_18 = PointXYZ(XComponent=addition_8, YComponent=subtraction, ZComponent=height, System=PlaneXY(0, 0, 0))
_1_19 = PointXYZ(XComponent=addition_6, YComponent=subtraction, ZComponent=subtraction_11, System=PlaneXY(0, 0, 0))
_1_20 = PointXYZ(XComponent=addition_6, YComponent=subtraction_2, ZComponent=subtraction_11, System=PlaneXY(0, 0, 0))
_1_21 = PointXYZ(XComponent=addition_8, YComponent=subtraction_2, ZComponent=height, System=PlaneXY(0, 0, 0))
_1_22 = PointXYZ(XComponent=addition_4, YComponent=addition, ZComponent=subtraction_7, System=PlaneXY(0, 0, 0))
_1_23 = PointXYZ(XComponent=addition_6, YComponent=subtraction, ZComponent=height, System=PlaneXY(0, 0, 0))
_1_24 = PointXYZ(XComponent=addition_4, YComponent=addition_2, ZComponent=height, System=PlaneXY(0, 0, 0))
_1_25 = PointXYZ(XComponent=addition_8, YComponent=subtraction, ZComponent=height, System=PlaneXY(0, 0, 0))
_1_26 = PointXYZ(XComponent=addition_2, YComponent=addition_2, ZComponent=height, System=PlaneXY(0, 0, 0))
_1_27 = PointXYZ(XComponent=addition_4, YComponent=addition, ZComponent=height, System=PlaneXY(0, 0, 0))
_1_28 = PointXYZ(XComponent=addition_2, YComponent=addition, ZComponent=height, System=PlaneXY(0, 0, 0))
_1_29 = PointXYZ(XComponent=addition_6, YComponent=subtraction_2, ZComponent=height, System=PlaneXY(0, 0, 0))
srf4pt = _4PointSurface(CornerA=_1, CornerB=_2, CornerC=_4, CornerD=_3)
srf4pt_2 = _4PointSurface(CornerA=_1, CornerB=_2, CornerC=_2a, CornerD=_1a)
srf4pt_3 = _4PointSurface(CornerA=_1a, CornerB=_2a, CornerC=_4a, CornerD=_3a)
srf4pt_4 = _4PointSurface(CornerA=_4, CornerB=_3, CornerC=_3a, CornerD=_4a)
srf4pt_5 = _4PointSurface(CornerA=_2, CornerB=_4, CornerC=_4a, CornerD=_2a)
srf4pt_6 = _4PointSurface(CornerA=_1, CornerB=_3, CornerC=_3a, CornerD=_1a)
srf4pt_7 = _4PointSurface(CornerA=_1_20, CornerB=_1_19, CornerC=_1_23, CornerD=_1_29)
srf4pt_8 = _4PointSurface(CornerA=_1_4, CornerB=_1_5, CornerC=_1_8, CornerD=_1_9)
srf4pt_9 = _4PointSurface(CornerA=_1_4, CornerB=_1_5, CornerC=_1_15, CornerD=_1_18)
srf4pt_10 = _4PointSurface(CornerA=_1_8, CornerB=_1_9, CornerC=_1_16, CornerD=_1_17)
srf4pt_11 = _4PointSurface(CornerA=_1_29, CornerB=_1_21, CornerC=_1_17, CornerD=_1_20)
srf4pt_12 = _4PointSurface(CornerA=_1_22, CornerB=_1_11, CornerC=_1_24, CornerD=_1_27)
srf4pt_13 = _4PointSurface(CornerA=_1_2, CornerB=_1_3, CornerC=_1_6, CornerD=_1_7)
srf4pt_14 = _4PointSurface(CornerA=_1_2, CornerB=_1_3, CornerC=_1_13, CornerD=_1_12)
srf4pt_15 = _4PointSurface(CornerA=_1_6, CornerB=_1_7, CornerC=_1_10, CornerD=_1_14)
srf4pt_16 = _4PointSurface(CornerA=_1_27, CornerB=_1_28, CornerC=_1_14, CornerD=_1_22)
srf4pt_17 = _4PointSurface(CornerA=_1_20, CornerB=_1_19, CornerC=_1_15, CornerD=_1_17)
srf4pt_18 = _4PointSurface(CornerA=_1_22, CornerB=_1_11, CornerC=_1_13, CornerD=_1_14)
srf4pt_19 = _4PointSurface(CornerA=_1_25, CornerB=_1_23, CornerC=_1_19, CornerD=_1_15)
srf4pt_20 = _4PointSurface(CornerA=_1_5, CornerB=_1_8, CornerC=_1_17, CornerD=_1_15)
srf4pt_21 = _4PointSurface(CornerA=_1_4, CornerB=_1_9, CornerC=_1_16, CornerD=_1_18)
srf4pt_22 = _4PointSurface(CornerA=_1_26, CornerB=_1_24, CornerC=_1_11, CornerD=_1_13)
srf4pt_23 = _4PointSurface(CornerA=_1_3, CornerB=_1_6, CornerC=_1_14, CornerD=_1_13)
srf4pt_24 = _4PointSurface(CornerA=_1_2, CornerB=_1_7, CornerC=_1_10, CornerD=_1_12)
subtraction_13 = Subtraction(A=length, B=inset)
axb_5 = Multiplication(A=leg_width, B=factor_2)
subtraction_14 = Subtraction(A=subtraction_13, B=leg_width)
addition_10 = Addition(A=subtraction_13, B=leg_skew)
subtraction_15 = Subtraction(A=width, B=inset)
subtraction_16 = Subtraction(A=subtraction_15, B=table_thickness)
subtraction_17 = Subtraction(A=length, B=inset)
subtraction_18 = Subtraction(A=subtraction_17, B=leg_width)
axb_6 = Multiplication(A=leg_width, B=factor_2)
addition_11 = Addition(A=subtraction_17, B=leg_skew)
subtraction_19 = Subtraction(A=addition_10, B=leg_width)
subtraction_20 = Subtraction(A=subtraction_13, B=axb_5)
subtraction_21 = Subtraction(A=addition_11, B=leg_width)
subtraction_22 = Subtraction(A=subtraction_17, B=axb_6)
_1_30 = PointXYZ(XComponent=addition_10, YComponent=addition_2, ZComponent=origin, System=PlaneXY(0, 0, 0))
_1_31 = PointXYZ(XComponent=subtraction_19, YComponent=addition_2, ZComponent=origin, System=PlaneXY(0, 0, 0))
_1_32 = PointXYZ(XComponent=subtraction_19, YComponent=addition, ZComponent=origin, System=PlaneXY(0, 0, 0))
_1_33 = PointXYZ(XComponent=addition_10, YComponent=addition, ZComponent=origin, System=PlaneXY(0, 0, 0))
_1_34 = PointXYZ(XComponent=subtraction_21, YComponent=subtraction_16, ZComponent=origin, System=PlaneXY(0, 0, 0))
_1_35 = PointXYZ(XComponent=addition_11, YComponent=subtraction_15, ZComponent=origin, System=PlaneXY(0, 0, 0))
_1_36 = PointXYZ(XComponent=subtraction_21, YComponent=subtraction_15, ZComponent=origin, System=PlaneXY(0, 0, 0))
_1_37 = PointXYZ(XComponent=addition_11, YComponent=subtraction_16, ZComponent=origin, System=PlaneXY(0, 0, 0))
_1_38 = PointXYZ(XComponent=subtraction_13, YComponent=addition_2, ZComponent=height, System=PlaneXY(0, 0, 0))
_1_39 = PointXYZ(XComponent=subtraction_13, YComponent=addition, ZComponent=height, System=PlaneXY(0, 0, 0))
_1_40 = PointXYZ(XComponent=subtraction_20, YComponent=addition_2, ZComponent=subtraction_7, System=PlaneXY(0, 0, 0))
_1_41 = PointXYZ(XComponent=subtraction_14, YComponent=addition_2, ZComponent=subtraction_3, System=PlaneXY(0, 0, 0))
_1_42 = PointXYZ(XComponent=subtraction_14, YComponent=addition, ZComponent=subtraction_3, System=PlaneXY(0, 0, 0))
_1_43 = PointXYZ(XComponent=subtraction_17, YComponent=subtraction_16, ZComponent=height, System=PlaneXY(0, 0, 0))
_1_44 = PointXYZ(XComponent=subtraction_22, YComponent=subtraction_15, ZComponent=subtraction_7, System=PlaneXY(0, 0, 0))
_1_45 = PointXYZ(XComponent=subtraction_17, YComponent=subtraction_15, ZComponent=height, System=PlaneXY(0, 0, 0))
_1_46 = PointXYZ(XComponent=subtraction_18, YComponent=subtraction_15, ZComponent=subtraction_3, System=PlaneXY(0, 0, 0))
_1_47 = PointXYZ(XComponent=subtraction_18, YComponent=subtraction_16, ZComponent=subtraction_3, System=PlaneXY(0, 0, 0))
_1_48 = PointXYZ(XComponent=subtraction_20, YComponent=addition, ZComponent=subtraction_7, System=PlaneXY(0, 0, 0))
_1_49 = PointXYZ(XComponent=subtraction_13, YComponent=addition_2, ZComponent=height, System=PlaneXY(0, 0, 0))
_1_50 = PointXYZ(XComponent=subtraction_20, YComponent=addition, ZComponent=height, System=PlaneXY(0, 0, 0))
_1_51 = PointXYZ(XComponent=subtraction_13, YComponent=addition, ZComponent=height, System=PlaneXY(0, 0, 0))
_1_52 = PointXYZ(XComponent=subtraction_20, YComponent=addition_2, ZComponent=height, System=PlaneXY(0, 0, 0))
_1_53 = PointXYZ(XComponent=subtraction_17, YComponent=subtraction_15, ZComponent=height, System=PlaneXY(0, 0, 0))
_1_54 = PointXYZ(XComponent=subtraction_22, YComponent=subtraction_15, ZComponent=height, System=PlaneXY(0, 0, 0))
_1_55 = PointXYZ(XComponent=subtraction_22, YComponent=subtraction_16, ZComponent=height, System=PlaneXY(0, 0, 0))
_1_56 = PointXYZ(XComponent=subtraction_17, YComponent=subtraction_16, ZComponent=height, System=PlaneXY(0, 0, 0))
_1_57 = PointXYZ(XComponent=subtraction_22, YComponent=subtraction_16, ZComponent=subtraction_7, System=PlaneXY(0, 0, 0))
srf4pt_25 = _4PointSurface(CornerA=_1_30, CornerB=_1_31, CornerC=_1_32, CornerD=_1_33)
srf4pt_26 = _4PointSurface(CornerA=_1_30, CornerB=_1_31, CornerC=_1_41, CornerD=_1_38)
srf4pt_27 = _4PointSurface(CornerA=_1_32, CornerB=_1_33, CornerC=_1_39, CornerD=_1_42)
srf4pt_28 = _4PointSurface(CornerA=_1_50, CornerB=_1_51, CornerC=_1_42, CornerD=_1_48)
srf4pt_29 = _4PointSurface(CornerA=_1_48, CornerB=_1_40, CornerC=_1_52, CornerD=_1_50)
srf4pt_30 = _4PointSurface(CornerA=_1_35, CornerB=_1_36, CornerC=_1_34, CornerD=_1_37)
srf4pt_31 = _4PointSurface(CornerA=_1_35, CornerB=_1_36, CornerC=_1_46, CornerD=_1_45)
srf4pt_32 = _4PointSurface(CornerA=_1_34, CornerB=_1_37, CornerC=_1_43, CornerD=_1_47)
srf4pt_33 = _4PointSurface(CornerA=_1_55, CornerB=_1_56, CornerC=_1_47, CornerD=_1_57)
srf4pt_34 = _4PointSurface(CornerA=_1_57, CornerB=_1_44, CornerC=_1_54, CornerD=_1_55)
srf4pt_35 = _4PointSurface(CornerA=_1_31, CornerB=_1_32, CornerC=_1_42, CornerD=_1_41)
srf4pt_36 = _4PointSurface(CornerA=_1_30, CornerB=_1_33, CornerC=_1_39, CornerD=_1_38)
srf4pt_37 = _4PointSurface(CornerA=_1_49, CornerB=_1_52, CornerC=_1_40, CornerD=_1_41)
srf4pt_38 = _4PointSurface(CornerA=_1_48, CornerB=_1_40, CornerC=_1_41, CornerD=_1_42)
srf4pt_39 = _4PointSurface(CornerA=_1_36, CornerB=_1_34, CornerC=_1_47, CornerD=_1_46)
srf4pt_40 = _4PointSurface(CornerA=_1_35, CornerB=_1_37, CornerC=_1_43, CornerD=_1_45)
srf4pt_41 = _4PointSurface(CornerA=_1_53, CornerB=_1_54, CornerC=_1_44, CornerD=_1_46)
srf4pt_42 = _4PointSurface(CornerA=_1_57, CornerB=_1_44, CornerC=_1_46, CornerD=_1_47)
