# Grasshopper definition ghTest2.ghx (Grasshopper 0.8.66)

width = Slider(57, range=0..120)
height = Slider(31.44, range=12..48)
panel = Panel("30")
length = Slider(81, range=0..120)
addition = Addition(A=length, B=panel)
subtraction = Subtraction(A=length, B=panel)
addition_2 = Addition(A=height, B=panel)
_1 = PointXYZ(XComponent=addition, YComponent=0, ZComponent=height, System=PlaneXY(0, 0, 0))
_1_2 = PointXYZ(XComponent=subtraction, YComponent=subtraction, ZComponent=addition_2, System=PlaneXY(0, 0, 0))
_1_3 = PointXYZ(XComponent=0, YComponent=width, ZComponent=0, System=PlaneXY(0, 0, 0))
_1_4 = PointXYZ(XComponent=length, YComponent=width, ZComponent=height, System=PlaneXY(0, 0, 0))
_1_5 = PointXYZ(XComponent=0, YComponent=0, ZComponent=height, System=PlaneXY(0, 0, 0))
srf4pt = _4PointSurface(CornerA=_1, CornerB=_1_2, CornerC=_1_4, CornerD=_1_4)
srf4pt_2 = _4PointSurface(CornerA=_1, CornerB=_1_2, CornerC=_1_3, CornerD=_1_3)
srf4pt_3 = _4PointSurface(CornerA=_1_2, CornerB=_1_3, CornerC=_1_4, CornerD=_1_4)
